# Dynamo custom node GetExternalWalls.dyf (Dynamo 0.8.2.2392)
# category: DynamoPlus.DynamoPlus.Scripts
# Returns all BuildingSurfaces that are WALLS with Boundary Condition OUTDOORS

list = Input(list : var[]..[])
inspect = DynamoPlus.Geometry.BuildingSurface.Inspect(list)
code_block = CodeBlock { "Wall"; "Outdoors"; }
allIndicesOf = List.AllIndicesOf(list=inspect.out4, item=code_block.out1)
allIndicesOf_2 = List.AllIndicesOf(list=inspect.out1, item=code_block.out0)
containsItem = List.ContainsItem(list=allIndicesOf_2, item=allIndicesOf)
filterByBoolMask = List.FilterByBoolMask(list=allIndicesOf, mask=containsItem)
getItemAtIndex = List.GetItemAtIndex(list=list, index=filterByBoolMask.in)
item = Output(getItemAtIndex)
