# Dynamo custom node PrepareGeometry.dyf (Dynamo 0.9.0.3067)
# category: DynamoPlus.DynamoPlus.Scripts
# Splits the geometry and returns all faces

element = Input(element : Element)
geometry = Element.Geometry(element)
code_block = CodeBlock { Point.ByCoordinates(0,0,3); Point.ByCoordinates(0,0,6); }
byOriginNormal = Plane.ByOriginNormal(origin=code_block.out0)
split = Geometry.Split(geometry=geometry, other=byOriginNormal, lacing=Longest)
byOriginNormal_2 = Plane.ByOriginNormal(origin=code_block.out1)
split_2 = Geometry.Split(geometry=split, other=byOriginNormal_2)
flatten = Flatten(split_2)
faces = Topology.Faces(flatten)
surfaceGeometry = Face.SurfaceGeometry(faces)
Surface = Output(surfaceGeometry)
